% Simulink data dictionary dcmtr_ctrl.sldd

Ctrl_Kd = Simulink.Parameter(-2.214, StorageClass="ExportedGlobal")
Ctrl_Ki = Simulink.Parameter(60, StorageClass="ExportedGlobal")
Ctrl_Kp = Simulink.Parameter(80, StorageClass="ExportedGlobal")
Ctrl_N = Simulink.Parameter(7, StorageClass="ExportedGlobal")
Ctrl_Ts = 0.01
mtrCtrl_config = Simulink.ConfigSet(StartTime="0", StopTime="inf", FixedStep="Ctrl_Ts", Solver="FixedStepDiscrete", ProdHWDeviceType="Intel->x86-64 (Windows64)", SystemTargetFile="ert.tlc", TargetLang="C")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