test file "dcmtrCTRL_PID_Tests"
  setup callback:
    setupUnixSiL()
  coverage: Decision, MCDC, Condition

suite "Simulation Test"

  case "Check MaxVolt Command" [simulation]
    model dcmtrCtrl_PID, harness dcmtrCtrl_PID_Harness0

  case "Check MaxVolt w Iterations" [simulation]
    model dcmtrCtrl_PID, harness dcmtrCtrl_PID_Harness1
    signal scenario: Test1 (dcmtrCtrl_PID_Harness1/Signal Editor)
    pre-load callback:
      load('dcmtr_params.mat')
    assessment "Assessment1": At any point of time, vCommand must be greater than or equal to single(-5) and less than or equal to single(5)
      vCommand: signal dcmtrCtrl_PID_Harness1/Output Conversion Subsystem, port 1
    iterations:
      Iteration1 (disabled): SignalBuilderGroup "SmoothStep"
      Iteration2 (disabled): SignalBuilderGroup "Step"
      Iteration3: SignalBuilderGroup "Test1"
      Iteration4: SignalBuilderGroup "Test2"
      Iteration5: SignalBuilderGroup "Test3"
      Iteration6: SignalBuilderGroup "Test4"
      Iteration7: SignalBuilderGroup "Test5"
      Iteration8: SignalBuilderGroup "Test6"

suite "Baseline Comparison"

  case "Performance under Varied MotorFriction" [baseline]
    model dcmtrCtrl_PID, harness dcmtrCtrl_PID_Harness1
    signal scenario: Test1 (dcmtrCtrl_PID_Harness1/Signal Editor)
    pre-load callback:
      load('dcmtr_params.mat')
    baseline "Iteration1.mat": abs tol 0.04 (1 of 3 signals compared)
      v
    baseline "Iteration2.mat": abs tol 0.04 (1 of 3 signals compared)
      v
    baseline "Iteration3.mat": abs tol 0.04 (1 of 3 signals compared)
      v
    baseline "Iteration4.mat": abs tol 0.04 (1 of 3 signals compared)
      v
    baseline "Iteration5.mat": abs tol 0.04 (1 of 3 signals compared)
      v
    baseline "Iteration6.mat": abs tol 0.04 (1 of 3 signals compared)
      v
    baseline "Iteration7.mat": abs tol 0.04 (1 of 3 signals compared)
      v
    baseline "Iteration8.mat": abs tol 0.04 (1 of 3 signals compared)
      v
    iterations:
      Iteration1: SignalBuilderGroup "SmoothStep", Baseline "Iteration1.mat"
      Iteration2: SignalBuilderGroup "Step", Baseline "Iteration2.mat"
      Iteration3: SignalBuilderGroup "Test1", Baseline "Iteration3.mat"
      Iteration4: SignalBuilderGroup "Test2", Baseline "Iteration4.mat"
      Iteration5: SignalBuilderGroup "Test3", Baseline "Iteration5.mat"
      Iteration6: SignalBuilderGroup "Test4", Baseline "Iteration6.mat"
      Iteration7: SignalBuilderGroup "Test5", Baseline "Iteration7.mat"
      Iteration8: SignalBuilderGroup "Test6", Baseline "Iteration8.mat"

suite "Equivalency Test"
  setup callback:
    scrubSharedUtils

  case "Confirm SIL Equivalency" [equivalence]
    simulation 1:
      model dcmtrCtrl_PID, harness dcmtrCtrl_PID_Harness0
      post-load callback:
        sltest.testsequence.editStep('dcmtrCtrl_PID_Harness0/Test Assessment',...
        'MONITOR_MAX_VOLT','Action','verify( abs(V) <= 5)');
    simulation 2:
      model dcmtrCtrl_PID, harness dcmtrCtrl_PID_Harness0, mode Software-in-the-Loop (SIL)
      post-load callback: same code as in post-load callback of case "Confirm SIL Equivalency"
    equivalence criteria (2 of 3 signals compared)
      v
      angle